# Dynamo graph SendDirectMessage.dyn (Dynamo 1.3.3.4651)

# group: INPUTS
base_url = StringInput("")
sender_id = StringInput("")
sender_password = StringInput("")
recipient_user_name = StringInput("")
message = StringInput("")

# group: Obtain session token
byLoginIdAndPassword = Custom[Authentication.ByLoginIdAndPassword](baseURL=base_url, loginID=sender_id, password=sender_password)
string = StringInput("Token")
# note: Token
byKey = Custom[Value.ByKey](keys=byLoginIdAndPassword.headerProperties, values=byLoginIdAndPassword.headerValues, search=string)  # Looks up a key in one list and returns the corresponding value from another list
string_2 = StringInput("id")
# note: User ID
byKey_2 = Custom[Value.ByKey](keys=byLoginIdAndPassword.userProperties, values=byLoginIdAndPassword.userValues, search=string_2)

# group: Obtain recipient user's ID
byUsername = Custom[Users.ByUsername](baseURL=base_url, token=byKey, searchTerms=recipient_user_name)
string_3 = StringInput("id")
byKey_3 = Custom[Value.ByKey](keys=byUsername.userProperties, values=byUsername.userValues, search=string_3)

# group: Create direct message channel and send message
create = List.Create(byKey_2, byKey_3)
byUsers = Custom[DirectMessageChannel.ByUsers](baseURL=base_url, token=byKey, userIDs=create)
string_4 = StringInput("id")
byKey_4 = Custom[Value.ByKey](keys=byUsers.channelProperties, values=byUsers.channelValues, search=string_4)
byChannelID = Custom[DirectMessage.ByChannelID](baseUrl=base_url, token=byKey, channelID=byKey_4, message=message)  # Sends a direct message to a given channel
